# Grasshopper definition 01_SaddleNet.ghx (Grasshopper 1.0.8)
# plug-ins: Arachne

cavi = Curve([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])
vincoli = Point([Point(0, 0, 2), Point(2.5, 0, 1), Point(5, 0, 0), Point(7.5, 0, -1), Point(10, 0, -2), Point(0, 2.5, 1), Point(10, 2.5, -1), Point(0, 5, 0), Point(10, 5, 0), Point(0, 7.5, -1), Point(10, 7.5, 1), Point(0, 10, -2), Point(2.5, 10, -1), Point(5, 10, 0), Point(7.5, 10, 1), Point(10, 10, 2)])
# ARACHNE | 01 Sella
# Rete 10 x 10 m, 4 x 4 campi, bordo vincolato con quote +/-2 m agli angoli.
# Beam (proprieta Cable, sezione piena D 10 mm, acciaio) + Force Density 1 N/m, caso di carico FF.
# Build Model in unita SI -> Form Find lineare. Auto Run attivo: disattivarlo e usare il pulsante Run.
lc = LoadCase(Name="FF", GravityNSM=False)
sc = SolidCircle(Diameter=0.01)
sm = Steel(Name="Steel", Grade=0)
bp = BeamProperty(Name="Cable", Type=1, Section=sc, Material=sm, Name_2="Cable", Type_2=1, Section_2=sc, Material_2=sm, Release=1)  # -> Property, Property_2
bm = Beam(Line=cavi, Property=bp.Property_2, Angle=0)
fd = ForceDensity(Beam=bm, Type=0, LoadCase=lc, Value=1, Project=False, Weight=1)
N = Node(Point=vincoli)
nr = Restraints(Node=N, Transational=[True, True, True])
bm_2 = BuildModel(Elements=flatten([fd, nr]), Units=1)
auto_run = BooleanToggle(True)
ff = FormFind(
    Model=bm_2,
    Gravity=0,
    Pressure=0,
    SolverType=0,
    MaxIter=20,
    Tolerance=0.0001,
    MaxIterS=0,
    ToleranceAS=0,
    ToleranceBS=0,
    CreateMesh=True,
    Plane=PlaneXY(0, 0, 0),
    AutoRun=auto_run)  # -> Model, Mesh
